# Grasshopper definition Assignment 4_Grasshopper.gh (Grasshopper 1.0.8)
# plug-ins: RhinoCodePluginGH

depth_map_control = Slider(7, range=1..10)
depth_divisions = Slider(16, range=8..20)
py3 = Python3Script(surface_height=Slider(4.643, range=0..20), surface_length=Slider(10, range=0..10), surface_width=Slider(10, range=0..10))  # -> out, base_surface
# ---------- py3: Python ----------
import Rhino
import Rhino.Geometry as rg
import math
import random


#define the parameters for the base surface
base_surface = rg.NurbsSurface.CreateFromCorners(
    rg.Point3d(surface_length, surface_width, surface_height),
    rg.Point3d(surface_length, -surface_width, surface_height),
    rg.Point3d(-surface_length, -surface_width, surface_height),
    rg.Point3d(-surface_length, surface_width, surface_height)
)


# Check and ensure it's a Surface (not a Brep)
if isinstance(base_surface, rg.Brep):
    base_surface = base_surface.Faces[0].UnderlyingSurface()

# Print the type to confirm it's a Surface
print(type(base_surface))  # Should print: <class 'Rhino.Geometry.Surface'>
# ---------- end py3 ----------
py3_2 = Python3Script(base_surface=py3.base_surface, depth_divisions=depth_divisions, depth_map_control=depth_map_control)  # -> modified_surface
# ---------- py3_2: Python ----------
"""
Assignment 3: Parametric Structural Canopy

Author: Martin Forná

Description:
This script generates a parametric structural canopy using depth maps and recursive geometry generation.
It explores different functions to control both the depth map and the fractal geometry to generate a
structural system composed of:
- A shell/gridshell
- A set of vertical supports

The script also combines different strategies for surface tessellation, quadratic, triangular and hexagonal elements to achieve 
a non-uniform tessellation of the input surface.

Note: This script is intended to be used within Grasshopper's Python scripting component.
"""

# Import necessary libraries
import Rhino
import Rhino.Geometry as rg
import rhinoscriptsyntax as rs
import math
import random
import numpy as np
from PIL import Image
import matplotlib.pyplot as plt
from matplotlib import colormaps

# Recursion_params has not been added as a grasshopper parameter yet as it seems to only transfer as a list instead of a dictionary
recursion_params = {
 'max_depth': 3,
 'vertical_angle': 20,
 'length': 4,
 'length_reduction': 0.5,
 'branches': 3,
 'angle_variation': 15
}

def ensure_surface(geometry):
    """
    Ensures the input geometry is a Rhino.Geometry.Surface. as passing it directly seems to reference the geometry 
    as a GUID instead of a surface

    Parameters:
    - geometry: The input geometry, potentially a Brep, GUID or other type.

    Returns:
    - A Rhino.Geometry.Surface object, if convertible.
    """
    # Coerce geometry to Rhino object
    geometry = rs.coercegeometry(geometry)

    # Check if the geometry needs altering, skip if yes.
    if isinstance(geometry, rg.Surface):
        return geometry

    # If it's a Brep, try to extract the underlying surface and only continue if the Berp is a single face
    if isinstance(geometry, rg.Brep):
        if geometry.Faces.Count == 1: 
            return geometry.Faces[0].UnderlyingSurface()
        else:
            raise ValueError("The input Brep has multiple faces. Expected a single surface.")

    # Raise an error if not a valid surface
    raise ValueError("Input must be a Surface or a single-face Brep.")

# Attempt to transform given surface into a usable surface
try:
    base_surface = ensure_surface(base_surface)
    print("Successfully converted to a Surface!")
except ValueError as e:
    print(f"Error: {e}")


# Makes sure the depth divisions are passed as integers
depth_divisions = int(depth_divisions)

def generate_depth_map(surface, control_value, variation_type=""):
    """
    Modifies the input surface based on a control function to create a depth map.

    Parameters:
    - surface: The base surface (rg.Surface)
    - control_value: A numerical value controlling the depth variation (float)
    - variation_type: The type of depth variation ("Sine", "Ripple" or "Roof") (string)
    - depth_divisions: Number of divisions along U and V directions (int)

    Returns:
    - modified_surface: The surface after applying the depth map
    """
    
    # Set the domain the u (x) and v (y) directions
    u_domain = surface.Domain(0)
    v_domain = surface.Domain(1)  
    
    # Create an empty list to store modified points
    modified_points = []

    # Create a point grid with refinement depending on depth_division    
    for i in range(depth_divisions):
        u_param = u_domain[0] + (u_domain[1] - u_domain[0]) * i / (depth_divisions - 1)
        for j in range(depth_divisions):
            v_param = v_domain[0] + (v_domain[1] - v_domain[0]) * j / (depth_divisions - 1)
            
            # Evaluate the point on the surface at (u_param, v_param)
            point = surface.PointAt(u_param, v_param)
           
            # Ripple effect: sin(10 * (x^2 + y^2)) / 10
            r_squared = point.X ** 2 + point.Y ** 2
            depth_variation = math.sin(10 * (r_squared) * control_value / 10)

            # Modify the Z-coordinate of the point
            modified_point = rg.Point3d(point.X, point.Y, point.Z + depth_variation)
            modified_points.append(modified_point)
    
    # Now creates a nurbs surface from the modified points
    # Pass the modified points as a flat list and provide grid dimensions
    modified_surface = rg.NurbsSurface.CreateThroughPoints(
        modified_points, depth_divisions, depth_divisions, 3, 3, False, False
    )

    return modified_surface, modified_points


if base_surface:
    # Generate modified surface with depth map
    modified_surface, modified_points = generate_depth_map(base_surface, depth_map_control)

else:
    # Handle cases where inputs are not provided
    print("Skipped something because of missing input")
    pass
# ---------- end py3_2 ----------
num_points = Slider(4, range=1..10)
colour = ColourPicker(PickedColour=RGB(8, 2, 2))
point_random = Python3Script(surface=py3_2, num_points=num_points)  # -> out, attractors; inputs num_points: Int32
# ---------- point_random: Python ----------
import rhinoscriptsyntax as rs
import random

def generate_attraction_points(surface, num_points):
    points = []
    
    # Get the domain of the surface in U and V directions
    u_domain = rs.SurfaceDomain(surface, 0)  
    v_domain = rs.SurfaceDomain(surface, 1)  
    
    for i in range(num_points):
        # Generate random UV coordinates within the surface's domain
        u = random.uniform(u_domain[0], u_domain[1])  #
        v = random.uniform(v_domain[0], v_domain[1])  
        
        # Evaluate the point on the surface
        point = rs.SurfaceEvaluate(surface, (u, v), 0)[0]  
        points.append(point)
    
    return points

attractors = generate_attraction_points(surface, num_points)
# ---------- end point_random ----------
points_support = Python3Script(surface=py3_2)  # -> out, attractors
# ---------- points_support: Python ----------
import rhinoscriptsyntax as rs

def generate_attraction_points(surface):
    points = []
    
    # Get the domain of the surface in U and V directions
    u_domain = rs.SurfaceDomain(surface, 0)  
    v_domain = rs.SurfaceDomain(surface, 1) 
    
    # Get the corners of the surface
    corner_1 = rs.SurfaceEvaluate(surface, (u_domain[0], v_domain[0]), 0)[0]
    corner_2 = rs.SurfaceEvaluate(surface, (u_domain[1], v_domain[0]), 0)[0]
    corner_3 = rs.SurfaceEvaluate(surface, (u_domain[1], v_domain[1]), 0)[0]
    corner_4 = rs.SurfaceEvaluate(surface, (u_domain[0], v_domain[1]), 0)[0]
    
    # Get the center of the surface 
    center_u = (u_domain[0] + u_domain[1]) / 2
    center_v = (v_domain[0] + v_domain[1]) / 2
    center = rs.SurfaceEvaluate(surface, (center_u, center_v), 0)[0]
    
    # Calculate the halfway points between the center and each corner
    point_1 = rs.SurfaceEvaluate(surface, ((u_domain[0] + center_u) / 2, (v_domain[0] + center_v) / 2), 0)[0]
    point_2 = rs.SurfaceEvaluate(surface, ((u_domain[1] + center_u) / 2, (v_domain[0] + center_v) / 2), 0)[0]
    point_3 = rs.SurfaceEvaluate(surface, ((u_domain[1] + center_u) / 2, (v_domain[1] + center_v) / 2), 0)[0]
    point_4 = rs.SurfaceEvaluate(surface, ((u_domain[0] + center_u) / 2, (v_domain[1] + center_v) / 2), 0)[0]
    
    points.extend([point_1, point_2, point_3, point_4])

    return points


attractors = generate_attraction_points(surface)
# ---------- end points_support ----------
colour_2 = ColourPicker(PickedColour=RGBA(112, 112, 112, 102))
filter_switch = ValueList({"Support": 1, "Random": 0}, selected="Random")
filter = StreamFilter(Gate=filter_switch, Stream0=point_random.attractors, Stream1=points_support.attractors)
preview = CustomPreview(Geometry=filter, Material=colour)
preview_2 = CustomPreview(Geometry=py3_2, Material=colour_2)
max_attraction_distance = Slider(6, range=0..8)
attraction_radius = Slider(1, range=1..10)
repulsion_force = Slider(0.1, range=0..1)
repulsion_radius = Slider(1.24, range=0..4)
attraction_force = Slider(0.2, range=0..1)
num_agents = Slider(100, range=1..200)
num_steps = Slider(40, range=1..200)
py3_3 = Python3Script(
    surface=py3_2,
    num_agents=num_agents,
    num_steps=num_steps,
    attractors=filter,
    attraction_radius=attraction_radius,
    max_attract_distance=max_attraction_distance,
    repulse_radius=repulsion_radius,
    repulse_force=repulsion_force,
    attract_force=attraction_force)  # -> out, agent_positions, agent_velocity, Delaunay_mesh, Delaunay_edges; inputs surface: Surface, num_agents: Int32, num_steps: Int32, attractors: list of Point3d, attraction_radius: Double, max_attract_distance: Double, repulse_radius: Double, repulse_force: Double, attract_force: Double
# ---------- py3_3: Python ----------
import Rhino.Geometry as rg
import random
import math
import scipy.spatial
import numpy as np

class Agent:
    """
    A class to represent an agent in the simulation.

    Attributes:
    - position: The current position of the agent (Point3d).
    - velocity: The current velocity of the agent (tuple).
    - surface: The surface on which the agent is confined. (NurbsSurface)

    Methods:
    - move(): Updates the agent's position and keeps it on the surface.
    - interact(): Defines how the agent interacts with attractors and other agents.
    - update(): Updates the agent's state.
    """
    def __init__(self, position, velocity, surface):
        self.position = position
        self.velocity = velocity
        self.surface = surface

    def move(self):
        """
        Update the agent's position based on its velocity and restrict it to the surface.
        """
        
        new_position = rg.Point3d(
            self.position.X + self.velocity[0],
            self.position.Y + self.velocity[1],
            self.position.Z + self.velocity[2]
        )

        # We use this to make sure the agents cannot leave the surface
        success, u, v = self.surface.ClosestPoint(new_position)
        if success:
            self.position = self.surface.PointAt(u, v)

    def interact(self, attractors, radius, max_attract_distance, agents, repulse_radius, repulse_force, attract_force):
        """
        Define interactions with attractor points and repulsion from nearby agents.
        Attributes:
        - attractors: Points to which the agents are attracted (Point3dList)
        - attract_force: The intensity of which the agents are attracted to the attractor points (float).
        - repulse_force: The intensity of which the agents are repulsed by each other (float).
        - surface: The surface on which the agent is confined. (NurbsSurface)
        - max_attract_distance: Radius of the area of effect for the attraction of agents. I.E. Agents outside of this distance are not affect by attraction (float).
        - repulse_radius: Radius of area of effect for the repulsion of agents. I.E. Agents outside of this distance are not affect by repulsion (float).
        """
        # Attraction logic
        closest_attractor = None
        closest_distance = float('inf')

        for attractor in attractors:
            distance = self.position.DistanceTo(attractor)
            if radius < distance <= max_attract_distance and distance < closest_distance:
                closest_attractor = attractor
                closest_distance = distance

        attractor_velocity = rg.Vector3d(0, 0, 0)
        if closest_attractor:
            direction = rg.Vector3d(
                closest_attractor.X - self.position.X,
                closest_attractor.Y - self.position.Y,
                closest_attractor.Z - self.position.Z
            )
            direction.Unitize()
            attractor_velocity = direction * (attract_force / (closest_distance + 0.01)) 

        # Repulsion logic
        repulsion_velocity = rg.Vector3d(0, 0, 0)
        for other_agent in agents:
            if other_agent is not self:
                distance = self.position.DistanceTo(other_agent.position)
                if distance < repulse_radius:
                    direction = rg.Vector3d(
                        self.position.X - other_agent.position.X,
                        self.position.Y - other_agent.position.Y,
                        self.position.Z - other_agent.position.Z
                    )
                    direction.Unitize()
                    repulsion_velocity += direction * (repulse_force / (distance + 0.01))  

        # Combine attractor and repulsion velocities to get a singular veloctiy for the agents
        self.velocity = (
            attractor_velocity.X + repulsion_velocity.X,
            attractor_velocity.Y + repulsion_velocity.Y,
            attractor_velocity.Z + repulsion_velocity.Z
        )

    def update(self):
        """
        Update the agent's state with random noise in movement to make it less detmerministic/stiff, and more erratic.
        """

        noise_x = random.uniform(-0.1, 0.1)
        noise_y = random.uniform(-0.1, 0.1)
        noise_z = random.uniform(-0.1, 0.1)

        
        self.velocity = (
            self.velocity[0] + noise_x,
            self.velocity[1] + noise_y,
            self.velocity[2] + noise_z
        )
        pass

# Simulation parameters
agents = []       
# num_agents: number of agents used in the simulation (int)
# num_steps: number of times the simulation is ran (int)

# Initialize agents with uniform distribution over the surface
u_domain = surface.Domain(0)  
v_domain = surface.Domain(1)  

grid_size = int(math.sqrt(num_agents)) 
u_values = [u_domain.Min + (u_domain.Length / (grid_size - 1)) * i for i in range(grid_size)]
v_values = [v_domain.Min + (v_domain.Length / (grid_size - 1)) * i for i in range(grid_size)]

for u in u_values:
    for v in v_values:
        if len(agents) < num_agents:
            position = surface.PointAt(u, v)

            # plots the agents intial postion, while setting the velocity to zero.
            velocity = (0, 0, 0)
            agent = Agent(position, velocity, surface)
            agents.append(agent)

# Simulation loop for all the agents over the specified number of steps
for step in range(num_steps):
    for agent in agents:
        agent.interact(attractors, attraction_radius, max_attract_distance, agents, repulse_radius, repulse_force, attract_force)
        agent.move()
        agent.update()

# After simulation, process results
agent_positions = [rg.Point3d(agent.position.X, agent.position.Y, agent.position.Z) for agent in agents]
agent_velocity = [rg.Point3d(agent.velocity[0], agent.velocity[1], agent.velocity[2]) for agent in agents]


# Generate a Delaunay mesh from the final agent positions
# Convert Rhino Point3d to numpy array for scipy
points_np = np.array([(pt.X, pt.Y, pt.Z) for pt in agent_positions])

# Compute Convex Hull using scipy.spatial.ConvexHull
hull = scipy.spatial.ConvexHull(points_np)

# Create a mesh from the convex hull vertices
mesh = rg.Mesh()
for pt in points_np:
    mesh.Vertices.Add(pt[0], pt[1], pt[2])

# Apply Delaunay triangulation from the hull points (for 2D projection of points)
hull_points_2d = np.array([(pt[0], pt[1]) for pt in points_np])
delaunay = scipy.spatial.Delaunay(hull_points_2d)

# Create faces from Delaunay triangulation
for simplex in delaunay.simplices:
    mesh.Faces.AddFace(int(simplex[0]), int(simplex[1]), int(simplex[2]))

# Output the mesh
Delaunay_mesh = mesh

# Now, trace the edges of the Delaunay triangulation
delaunay_lines = []
for simplex in delaunay.simplices:
    # Create lines between the points that form the edges of the triangle of each cell in the mesh
    pt1 = points_np[simplex[0]]
    pt2 = points_np[simplex[1]]
    pt3 = points_np[simplex[2]]

    line1 = rg.Line(rg.Point3d(pt1[0], pt1[1], pt1[2]), rg.Point3d(pt2[0], pt2[1], pt2[2]))
    line2 = rg.Line(rg.Point3d(pt2[0], pt2[1], pt2[2]), rg.Point3d(pt3[0], pt3[1], pt3[2]))
    line3 = rg.Line(rg.Point3d(pt3[0], pt3[1], pt3[2]), rg.Point3d(pt1[0], pt1[1], pt1[2]))

    delaunay_lines.append(line1)
    delaunay_lines.append(line2)
    delaunay_lines.append(line3)

# Output the lines
Delaunay_edges = delaunay_lines
# ---------- end py3_3 ----------
py3_4 = Python3Script(agents=py3_3.agent_positions, attractors=filter)  # -> out, a; inputs agents: list of Point3d, attractors: list of Point3d
# ---------- py3_4: Python ----------
import Rhino.Geometry as rg

# Inputs:
# agents: A list of agent positions (list of Point3d)
# attractors: A list of attractor points (list of Point3d)

# Initialize a list to store the minimum distances for each agent
min_distances = []

# Loop through each agent
for agent in agents:
    # Initialize a variable to hold the minimum distance to an attractor
    min_distance = float('inf')
    
    # Loop through each attractor
    for attractor in attractors:
        # Calculate the distance between the agent and the attractor
        distance = agent.DistanceTo(attractor)
        
        # Update the minimum distance if this attractor is closer
        if distance < min_distance:
            min_distance = distance
    
    # Add the minimum distance for this agent to the list
    min_distances.append(min_distance)

# Output: List of minimum distances from agents to the closest attractor
a = min_distances
# ---------- end py3_4 ----------
bnd = Bounds(Numbers=py3_4.a)
gradient = Gradient(
    LowerLimit=bnd,
    UpperLimit=1,
    Parameter=py3_4.a,
    stops=[0.0365: RGB(186, 199, 46), 0.18: RGB(96, 8, 156), 0.306: RGB(47, 98, 35), 0.411: RGB(115, 180, 41), 0.475: RGB(164, 120, 126), 0.566: RGB(255, 130, 160), 0.676: RGB(138, 222, 187), 0.776: RGB(167, 240, 190), 0.941: RGB(220, 0, 40)])
vdis = VectorDisplay(Anchor=py3_3.agent_positions, Vector=py3_3.agent_velocity)
preview_3 = CustomPreview(Geometry=py3_3.agent_positions, Material=gradient)
